# Dynamo graph RMD_script.dyn "MCG_RMD Propping" (Dynamo 2.16.2.5624)

select_model_elements = DSModelElementsSelection()  # 4 picked in the model
geometry = Element.Geometry()  # unwired: element
trueForAll = List.TrueForAll()  # unwired: list, queryFunction
select_model_element = DSModelElementSelection()  # 1 picked in the model; graph input
curve = CurveElement.Curve(curveElement=select_model_element)

# group: Placing End Jacks
startPoint = Curve.StartPoint(curve=curve)
direction = Line.Direction(line=curve)
code_block = CodeBlock { 500; }
translate = Geometry.Translate(geometry=startPoint, direction=direction, distance=code_block)
byStartPointEndPoint = Line.ByStartPointEndPoint(startPoint=translate, endPoint=startPoint)
endPoint = Curve.EndPoint(curve=curve)
reverse = Vector.Reverse(vector=direction)
translate_2 = Geometry.Translate(geometry=endPoint, direction=reverse, distance=code_block)
byStartPointEndPoint_2 = Line.ByStartPointEndPoint(startPoint=translate_2, endPoint=endPoint)
list_create = List.Create(item0=byStartPointEndPoint, item1=byStartPointEndPoint_2)
levels = Levels("Datum")
family_types = FamilyTypes("SSU10007:SSU10007")
beamByCurve = StructuralFraming.BeamByCurve(curve=list_create, level=levels, structuralFramingType=family_types)

code_block_2 = CodeBlock { 3600; 2700; 1800; 900; 720; 540; 360; 180; 90; }
list_create_2 = List.Create(item0=code_block_2.out0, item1=code_block_2.out1, item2=code_block_2.out2, item3=code_block_2.out3, item4=code_block_2.out4, item5=code_block_2.out5, item6=code_block_2.out6, item7=code_block_2.out7, item8=code_block_2.out8)
watch = Watch(list_create_2)
family_types_2 = FamilyTypes("SSX13600:SSX13600")
family_types_3 = FamilyTypes("SSX12700:SSX12700")
family_types_4 = FamilyTypes("SSX11800:SSX11800")
family_types_5 = FamilyTypes("SSX10900:SSX10900")
family_types_6 = FamilyTypes("SSX10720:SSX10720")
family_types_7 = FamilyTypes("SSX10540:SSX10540")
family_types_8 = FamilyTypes("SSX10360:SSX10360")
family_types_9 = FamilyTypes("SSX10180:SSX10180")
family_types_10 = FamilyTypes("SSX10090:SSX10090")
list_create_3 = List.Create(item0=family_types_2, item1=family_types_3, item2=family_types_4, item3=family_types_5, item4=family_types_6, item5=family_types_7, item6=family_types_8, item7=family_types_9, item8=family_types_10)
watch_2 = Watch(list_create_3)

# group: 1st Iteration
byStartPointEndPoint_3 = Line.ByStartPointEndPoint(startPoint=translate, endPoint=translate_2)
startPoint_2 = Curve.StartPoint(curve=byStartPointEndPoint_3)
direction_2 = Line.Direction(line=byStartPointEndPoint_3)
length = Curve.Length(curve=byStartPointEndPoint_3)
div = length / watch
code_block_3 = CodeBlock { 1; }
gt = div > code_block_3
filterByBoolMask = List.FilterByBoolMask(list=watch, mask=gt)
code_block_4 = CodeBlock { 0; }
getItemAtIndex = List.GetItemAtIndex(list=filterByBoolMask.in, index=code_block_4)
translate_3 = Geometry.Translate(geometry=startPoint_2, direction=direction_2, distance=getItemAtIndex)
byStartPointEndPoint_4 = Line.ByStartPointEndPoint(startPoint=startPoint_2, endPoint=translate_3)
levels_2 = Levels("Datum")
filterByBoolMask_2 = List.FilterByBoolMask(list=watch_2, mask=gt)
getItemAtIndex_2 = List.GetItemAtIndex(list=filterByBoolMask_2.in, index=code_block_4)
beamByCurve_2 = StructuralFraming.BeamByCurve(curve=byStartPointEndPoint_4, level=levels_2, structuralFramingType=getItemAtIndex_2)

# group: 2nd Iteration
endPoint_2 = Curve.EndPoint(curve=byStartPointEndPoint_4)
byStartPointEndPoint_5 = Line.ByStartPointEndPoint(startPoint=endPoint_2, endPoint=translate_2)
startPoint_3 = Curve.StartPoint(curve=byStartPointEndPoint_5)
direction_3 = Line.Direction(line=byStartPointEndPoint_5)
length_2 = Curve.Length(curve=byStartPointEndPoint_5)
div_2 = length_2 / watch
code_block_5 = CodeBlock { 1; }
gt_2 = div_2 > code_block_5
filterByBoolMask_3 = List.FilterByBoolMask(list=watch, mask=gt_2)
code_block_6 = CodeBlock { 0; }
getItemAtIndex_3 = List.GetItemAtIndex(list=filterByBoolMask_3.in, index=code_block_6)
translate_4 = Geometry.Translate(geometry=startPoint_3, direction=direction_3, distance=getItemAtIndex_3)
byStartPointEndPoint_6 = Line.ByStartPointEndPoint(startPoint=startPoint_3, endPoint=translate_4)
levels_3 = Levels("Datum")
filterByBoolMask_4 = List.FilterByBoolMask(list=watch_2, mask=gt_2)
getItemAtIndex_4 = List.GetItemAtIndex(list=filterByBoolMask_4.in, index=code_block_6)
beamByCurve_3 = StructuralFraming.BeamByCurve(curve=byStartPointEndPoint_6, level=levels_3, structuralFramingType=getItemAtIndex_4)

# group: 3rd Iteration
endPoint_3 = Curve.EndPoint(curve=byStartPointEndPoint_6)
byStartPointEndPoint_7 = Line.ByStartPointEndPoint(startPoint=endPoint_3, endPoint=translate_2)
startPoint_4 = Curve.StartPoint(curve=byStartPointEndPoint_7)
direction_4 = Line.Direction(line=byStartPointEndPoint_7)
length_3 = Curve.Length(curve=byStartPointEndPoint_7)
div_3 = length_3 / watch
code_block_7 = CodeBlock { 1; }
gt_3 = div_3 > code_block_7
filterByBoolMask_5 = List.FilterByBoolMask(list=watch, mask=gt_3)
code_block_8 = CodeBlock { 0; }
getItemAtIndex_5 = List.GetItemAtIndex(list=filterByBoolMask_5.in, index=code_block_8)
translate_5 = Geometry.Translate(geometry=startPoint_4, direction=direction_4, distance=getItemAtIndex_5)
byStartPointEndPoint_8 = Line.ByStartPointEndPoint(startPoint=startPoint_4, endPoint=translate_5)
levels_4 = Levels("Datum")
filterByBoolMask_6 = List.FilterByBoolMask(list=watch_2, mask=gt_3)
getItemAtIndex_6 = List.GetItemAtIndex(list=filterByBoolMask_6.in, index=code_block_8)
beamByCurve_4 = StructuralFraming.BeamByCurve(curve=byStartPointEndPoint_8, level=levels_4, structuralFramingType=getItemAtIndex_6)

# group: 4th Iteration
endPoint_4 = Curve.EndPoint(curve=byStartPointEndPoint_8)
byStartPointEndPoint_9 = Line.ByStartPointEndPoint(startPoint=endPoint_4, endPoint=translate_2)
startPoint_5 = Curve.StartPoint(curve=byStartPointEndPoint_9)
direction_5 = Line.Direction(line=byStartPointEndPoint_9)
length_4 = Curve.Length(curve=byStartPointEndPoint_9)
div_4 = length_4 / watch
code_block_9 = CodeBlock { 1; }
gt_4 = div_4 > code_block_9
filterByBoolMask_7 = List.FilterByBoolMask(list=watch, mask=gt_4)
code_block_10 = CodeBlock { 0; }
getItemAtIndex_7 = List.GetItemAtIndex(list=filterByBoolMask_7.in, index=code_block_10)
translate_6 = Geometry.Translate(geometry=startPoint_5, direction=direction_5, distance=getItemAtIndex_7)
byStartPointEndPoint_10 = Line.ByStartPointEndPoint(startPoint=startPoint_5, endPoint=translate_6)
levels_5 = Levels("Datum")
filterByBoolMask_8 = List.FilterByBoolMask(list=watch_2, mask=gt_4)
getItemAtIndex_8 = List.GetItemAtIndex(list=filterByBoolMask_8.in, index=code_block_10)
beamByCurve_5 = StructuralFraming.BeamByCurve(curve=byStartPointEndPoint_10, level=levels_5, structuralFramingType=getItemAtIndex_8)

list_create_4 = List.Create(item0=beamByCurve, item1=beamByCurve_2, item2=beamByCurve_3, item3=beamByCurve_4, item4=beamByCurve_5)

# group: Set Z Justification to Center
code_block_11 = CodeBlock { "z Justification"; }
parameterByName = Parameter.ParameterByName(element=list_create_4, name=code_block_11)
code_block_12 = CodeBlock { 2; }
setValue = Parameter.SetValue(parameter=parameterByName, value=code_block_12)

python_script = Python(IN[0]=beamByCurve_2)  # CPython3
# ---------- python_script.python (34 lines) ----------
#### General imports  ##### 
import clr
clr.AddReference("RevitAPI")
import Autodesk
from Autodesk.Revit.DB import *
clr.AddReference("RevitServices")
import RevitServices
from RevitServices.Persistence import DocumentManager
from RevitServices.Transactions import TransactionManager
clr.AddReference("RevitNodes")
import Revit
clr.ImportExtensions(Revit.Elements)
#### End of General imports  ##### 
# Unwrap inputs
input = UnwrapElement( IN[0] )
elements = []
#force input into list
try:
    for e in input:
        if e.Category.Name == "Structural Framing":
            elements.append(e)
except:
    if input.Category.Name == "Structural Framing": 
        elements.append(input)
# Start Transaction
doc = DocumentManager.Instance.CurrentDBDocument
TransactionManager.Instance.EnsureInTransaction(doc)
for e in elements:
    Autodesk.Revit.DB.Structure.StructuralFramingUtils.DisallowJoinAtEnd(e, 0)
    Autodesk.Revit.DB.Structure.StructuralFramingUtils.DisallowJoinAtEnd(e, 1)
# End Transaction
TransactionManager.Instance.TransactionTaskDone()
# Wrap
OUT = elements
# ----------------------------------------
python_script_2 = Python(IN[0]=beamByCurve_3)  # CPython3; same code as python_script
python_script_3 = Python(IN[0]=beamByCurve)  # CPython3; same code as python_script
python_script_4 = Python(IN[0]=beamByCurve_4)  # CPython3; same code as python_script
python_script_5 = Python(IN[0]=beamByCurve_5)  # CPython3; same code as python_script
